# Requirement set aoe4066_team6_main (R2024a)

## 1 [1] Maximum Takeoff Mass
The takeoff mass of the aircraft shall not exceed 25,000 kg.

## 2 [2] Maximum Payload Mass
Each payload should not exceed 10,000 kg.

## 3 [#55] Lift
The aircraft shall produce lift equal to __

## 4 [3] Targeted Entry Year
The fleet should be ready for service by the year 2035.

## 5 [4] Budget
The overall budget of the fleet shall not exceed 100 million euros.

## 6 [#56] Aircraft Cost

## 7 [5] FAA Requirements
Must meet Title 14 Chapter 1 Subchapter C Part 25 Requirements.

## 8 [6] Fire Detection
Must be able to detect fires and risk areas.

## 9 [7] Fire Suppression
Must be able to put out fires and prevent spread to risk areas.

## 10 [8] Takeoff Distance
The fleet should be able to takeoff from less than 2500 feet.

## 11 [9] Response Time
Fleet shall be able to respond to a threat in no more than two hours.

## 12 [10] Service Ceiling
Service ceiling for the fleet must be at least 14,000 feet.

## 13 [11] Temperature
Fleet must have the ability to sustain heats of approximately 250*F.

## 14 [12] Corrosion Resistance
Any surfaces typically in contact with water must be resistant to corrosion.

## 15 [13] Engine
Aircraft shall use a TRL 9 engine.

## 16 [14] Scooping
Aircraft shall be able to refill water supply from existing water sources.

## 17 [15] Range
Aircraft should have the ability to fly a distance of 1,300 nm without refueling.

## 18 [16] Coverage Area
Aircraft's payload should cover () square feet of forest before refilling.

## 19 [17] Capacity
Aircraft should hold at least 1,500 gallons of water.

## 20 [19] STOL
Aircraft shall be capable of short takeoff and landing.

## 21 [20] High Lift
Aircraft shall have high lifting wings for short takeoff and landing.

## 22 [21] Stall Speed
Aircraft shall have a stall speed of no more than 60 kts at MTOW.

## 23 [22] Propulstion Type
Aircraft should be operated using a propellor.

## 24 [24] Pilot Visibility
The pilot should have 240 degrees of visibility.

## 25 [25] Wave Height
The aircraft shall sustain waves of 6 feet in height.

## 26 [26] Land Refill Time
When on land, tank should refill in less than 5 minutes.

## 27 [28] Fuel Efficiency
The engine picked shall have high fuel efficiency.

## 28 [29] Climb Rate
The aircraft shall have a climb rate of 1000 ft/min.

## 29 [30] Thrust/Weight Ratio
Should have a high thrust/weight ratio.

## 30 [31] Maximum Weight Factor
Shall sustain weight factors of up to 4 g's.

## 31 [32] Payload Drop
Should have the ability to drop it's payload both all at once and dispersed over an area.

## 32 [33] Engine Out
Vertical stabilizer shall compensate for thrust moment imbalance from one engine out.

## 33 [35] Floatation Devices
Aircraft shall have floatation on board incase of emergency water landing.

## 34 [36] Search and Rescue
Aircraft should be search and rescue capable.

## 35 [37] Lights
Aircraft shalll have exterior lights in accordance to the FAA requirements.

## 36 [38] Air Conditioning
Aircraft shall have A/C due to high temperature environment.

## 37 [40] Payload Targetting
Aircraft should use systems to accurately target and drop its payload.

## 38 [41] Mechanical Downtime
Aircraft should use predicitive maintenance to avoid excess mechanical downtime.

## 39 [42] Interfleet Communication
Aircraft shall have the ability to communicate with other vehicles within the fleet.

## 40 [43] Color
Aircraft shall be highly visible in both night and day conditions.

## 41 [44] Bilge Pump
Aircraft shall be able to remove excess water.

## 42 [45] Max Landing Vertical Speed
Aircraft shall sustain vertical landing velocity of 10 ft/s.

## 43 [46] Impact Resistance
Aircraft shall sustain water impacts from scooping.

## 44 [47] Ash/Smoke Ingestion
Engine shall still be able to work in areas of high ash/smoke concentration.

## 45 [48] Water Ingestion
Engine shall still be able to work despite ocean/payload spray.

## 46 [49] Scooping Friction
Aircraft shall sustain sudden increases in frictional forces/moments while scooping water.

## 47 [18] Amphibious
Aircraft shall be able to takeoff and land on water.

## 48 [27] Water Refill Time
When on water, tank should refill in less than 30 seconds.

## 49 [23] Water Depth
Aircraft should operate with a minimum water depth of 5 feet.

## 50 [39] Overfill Protection
Aircraft shall not be able to exceed its MTOW due to overfilling.

## 51 [34] Waterproof
Aircraft shall be water tight in places water could cause damage.